# Grasshopper definition intro_after.gh (Grasshopper 1.0.7)
# plug-ins: Monoceros

pt = ConstructPoint(XCoordinate=0, YCoordinate=2, ZCoordinate=0)
pt_2 = ConstructPoint(XCoordinate=0, YCoordinate=0, ZCoordinate=0)
sph = Sphere(Base=pt, Radius=Slider(0.5, range=0..1))

number_slider = Slider(1, range=0..10)
number_slider_2 = Slider(4, range=0..10)
ruleexp = ConstructExplicitRule(
    SourceModuleName="empty",
    SourceConnectorIndex=number_slider_2,
    TargetModuleName="empty",
    TargetConnectorIndex=number_slider)
ruleexp_2 = ConstructExplicitRule(
    SourceModuleName="module0",
    SourceConnectorIndex=number_slider_2,
    TargetModuleName="module0",
    TargetConnectorIndex=number_slider)
ruleexp_3 = ConstructExplicitRule(
    SourceModuleName="module0",
    SourceConnectorIndex=number_slider_2,
    TargetModuleName="empty",
    TargetConnectorIndex=number_slider)

constmodule = ConstructModule(ModuleName="module0", ModulePartPoints=pt, Geometry=sph, BasePlane=PlaneXY(0, 0, 0), ModulePartDiagonal=Vector(1, 1, 1))
moduleempty = ConstructEmptyModule(BasePlane=pt_2, ModulePartDiagonal=Vector(1, 1, 1))  # -> Module, Rules
merge = Merge(Data1=constmodule, Data2=moduleempty.Module)

rulebound = ConstructRuleAtBoundary(Module=moduleempty.Module, ConnectorIndex=number_slider_2)
rulebound_2 = ConstructRuleAtBoundary(Module=constmodule, ConnectorIndex=number_slider)

merge_2 = Merge(Data1=ruleexp_3, Data2=ruleexp_2, Data3=ruleexp, Data4=rulebound, Data5=rulebound_2)
ruleindiffunused = IndifferentRulesForUnusedConnectors(Module=merge, Rules=merge_2)  # -> flatten(RulesIndifferent)
merge_3 = Merge(Data1=ruleindiffunused, Data2=merge_2)  # -> flatten(Result)

sqgrid = Square(Plane=PlaneXY(0, 0, 0), Size=1, ExtentX=5, ExtentY=5)  # -> Cells, Points
flatten = FlattenTree(Tree=sqgrid.Points, Path="{0}")
X = UnitX(Factor=Slider(2, range=0..10))
move = Move(Geometry=flatten, Motion=X)  # -> Geometry, Transform
slotall = ConstructSlotWithAllModulesAllowed(SlotPoint=move.Geometry, BasePlane=PlaneXY(0, 0, 0), GridSlotDiagonal=Vector(1, 1, 1))

wfc = MonocerosWFCSolver(
    Slots=slotall,
    Modules=merge,
    Rules=merge_3,
    RandomSeed=Slider(48, range=0..100),
    MaxAttempts=10,
    MaxObservations=2147483647,
    MaxTime=0,
    UseShannonEntropy=False)  # -> Out, Slots, Deterministic, Contradictory, Seed, Attempts, Observations
materialize = MaterializeSlots(Modules=constmodule, Slots=wfc.Slots)  # -> Geometry, Transform
