# Grasshopper definition intro_before.gh (Grasshopper 1.0.7)

pt = ConstructPoint(XCoordinate=0, YCoordinate=2, ZCoordinate=0)
pt_2 = ConstructPoint(XCoordinate=0, YCoordinate=0, ZCoordinate=0)
sph = Sphere(Base=pt, Radius=Slider(0.5, range=0..1))

number_slider = Slider(1, range=0..10)
number_slider_2 = Slider(4, range=0..10)
panel = Panel("module0")
panel_2 = Panel("empty")

sqgrid = Square(Plane=PlaneXY(0, 0, 0), Size=1, ExtentX=5, ExtentY=5)  # -> Cells, Points
flatten = FlattenTree(Tree=sqgrid.Points, Path="{0}")
X = UnitX(Factor=Slider(2, range=0..10))
move = Move(Geometry=flatten, Motion=X)  # -> Geometry, Transform
