# Grasshopper definition structure_after.gh (Grasshopper 1.0.7)
# plug-ins: Monoceros

geo = Geometry([<brep referenced from the Rhino model> x13])
geo_2 = Geometry([<brep referenced from the Rhino model> x2])
geo_3 = Geometry([<brep referenced from the Rhino model> x13])
geo_4 = Geometry(<brep referenced from the Rhino model>)
geo_5 = Geometry(<brep referenced from the Rhino model>)
mesh = Mesh(geo)
mesh_2 = Mesh(geo_2)
mesh_3 = Mesh(geo_4)
mesh_4 = Mesh(geo_5)
mesh_5 = Mesh(geo_3)
vec = VectorXYZ(XComponent="0.5", YComponent="0.25", ZComponent="1")  # -> Vector, Length
cluster = Cluster_2(list=mesh_2)  # -> first, last, rest
cluster_2 = Cluster_2(list=mesh)  # -> first, last, rest
swatch = ColourSwatch(SwatchColor=RGB(255, 77, 77))
swatch_2 = ColourSwatch(SwatchColor=RGB(255, 190, 77))
swatch_3 = ColourSwatch(SwatchColor=RGB(103, 159, 219))
cluster_3 = Cluster_2(list=mesh_5)  # -> first, last, rest
cluster_4 = Cluster(color=swatch_2, mesh=mesh_3, light=vec.Vector)  # -> flatten(mesh_2)
cluster_5 = Cluster(color=swatch_2, mesh=cluster.last, light=vec.Vector)  # -> flatten(mesh_2)
cluster_6 = Cluster(color=swatch, mesh=cluster.first, light=vec.Vector)  # -> flatten(mesh_2)
cluster_7 = Cluster(color=swatch_3, mesh=cluster_2.first, light=vec.Vector)
cluster_8 = Cluster(color=swatch_2, mesh=cluster_2.last, light=vec.Vector)
cluster_9 = Cluster(color=swatch, mesh=cluster_2.rest, light=vec.Vector)
cluster_10 = Cluster(color=swatch_3, mesh=cluster_3.first, light=vec.Vector)
cluster_11 = Cluster(color=swatch_2, mesh=cluster_3.last, light=vec.Vector)
cluster_12 = Cluster(color=swatch, mesh=cluster_3.rest, light=vec.Vector)
cluster_13 = Cluster(color=swatch_2, mesh=mesh_4, light=vec.Vector)
merge = Merge(Data1=cluster_7, Data2=cluster_8, Data3=cluster_9)  # -> flatten(Result)
merge_2 = Merge(Data1=cluster_5, Data2=cluster_6)  # -> flatten(Result)
merge_3 = Merge(Data1=cluster_10, Data2=cluster_11, Data3=cluster_12)  # -> flatten(Result)
entwine = Entwine(Branch00=cluster_4, Branch01=merge_2, Branch02=merge, Branch03=merge_3, Branch04=cluster_13, FlattenInputs=True)  # -> simplify(Result)
geo_6 = Geometry(entwine)

group = Group(Objects=geo_6)  # -> flatten(Group)
lng = ListLength(List=group)
series = Series(Start=0, Step=1, Count=lng)
concat = Concatenate(FragmentA="module", FragmentB=series)
graft = GraftTree(Tree=concat, IncludeEmptyLists=True, IncludeNullItems=True)

number_slider = Slider(2, range=0..10)
series_2 = Series(Start=number_slider, Step=number_slider, Count=Slider(5, range=0..10))
number_slider_2 = Slider(0.5, range=0..1)
pt = ConstructPoint(XCoordinate=series_2, YCoordinate=0, ZCoordinate=0)
box = CenterBox(Base=pt, X=number_slider_2, Y=number_slider_2, Z=number_slider_2)
graft_2 = GraftTree(Tree=pt, IncludeEmptyLists=True, IncludeNullItems=True)  # -> simplify(Tree)

pt_2 = ConstructPoint(XCoordinate=0, YCoordinate=0, ZCoordinate=0)
moduleempty = ConstructEmptyModule(BasePlane=pt_2, ModulePartDiagonal=Vector(1, 1, 1))  # -> Module, Rules

debrep = DeconstructBrep(Brep=box)  # -> Faces, Edges, Vertices
area = Area(Geometry=debrep.Faces)  # -> Area, Centroid

constmodule = ConstructModule(
    ModuleName=graft,
    ModulePartPoints=graft_2,
    Geometry=geo_6,
    BasePlane=PlaneXY(0, 0, 0),
    ModulePartDiagonal=Vector(1, 1, 1))  # -> simplify(Module)
merge_4 = Merge(Data1=moduleempty.Module, Data2=constmodule)
flatten = FlattenTree(Tree=merge_4, Path="{0}")

pt_3 = Point([<point referenced from the Rhino model> x2])
pt_4 = Point([<point referenced from the Rhino model> x2])
pt_5 = Point([<point referenced from the Rhino model> x2])
data = Data(flatten)
ruletyppt = TypedRuleFromPoint(Modules=data, PointTag=pt_4, ConnectorType="type-a")
ruletyppt_2 = TypedRuleFromPoint(Modules=data, PointTag=pt_3, ConnectorType="type-b")
ruletyppt_3 = TypedRuleFromPoint(Modules=data, PointTag=pt_5, ConnectorType="type-c")
merge_5 = Merge(Data1=ruletyppt, Data2=ruletyppt_2, Data3=ruletyppt_3)  # -> flatten(Result)
ruleindiffunused = IndifferentRulesForUnusedConnectors(Module=data, Rules=merge_5)
merge_6 = Merge(Data1=ruleindiffunused, Data2=merge_5, Data3=moduleempty.Rules)  # -> flatten(Result)

number_slider_3 = Slider(5, range=0..10)
number_slider_4 = Slider(6, range=0..10)
pt_6 = ConstructPoint(XCoordinate=number_slider_3, YCoordinate=number_slider_3, ZCoordinate=0)
series_3 = Series(Start=0, Step=1, Count=Slider(6, range=0..10))
sqgrid = Square(Plane=pt_6, Size=1, ExtentX=number_slider_4, ExtentY=number_slider_4)  # -> Cells, Points
graft_3 = GraftTree(Tree=series_3, IncludeEmptyLists=True, IncludeNullItems=True)
flatten_2 = FlattenTree(Tree=sqgrid.Points, Path="{0}")
Z = UnitZ(Factor=graft_3)
move = Move(Geometry=flatten_2, Motion=Z)  # -> Geometry, Transform
flatten_3 = FlattenTree(Tree=move.Geometry, Path="{0}")
slotall = ConstructSlotWithAllModulesAllowed(SlotPoint=flatten_3, BasePlane=PlaneXY(0, 0, 0), GridSlotDiagonal=Vector(1, 1, 1))

panel = Panel("""0
3""")
panel_2 = Panel("""1
4""")
merge_7 = Merge(Data1=panel, Data2=panel_2)
rev = ReverseList(List=panel)
rev_2 = ReverseList(List=panel_2)
merge_8 = Merge(Data1=rev, Data2=rev_2)
ruleexp = ConstructExplicitRule(SourceModuleName="empty", SourceConnectorIndex=merge_7, TargetModuleName="module4", TargetConnectorIndex=merge_8)
ruleexp_2 = ConstructExplicitRule(SourceModuleName="empty", SourceConnectorIndex=merge_7, TargetModuleName="module3", TargetConnectorIndex=merge_8)

panel_3 = Panel("""4
3""")
panel_4 = Panel("""1
0""")
panel_5 = Panel("""0
1
3
4""")
panel_6 = Panel("""3
4
0
1""")
ruleexp_3 = ConstructExplicitRule(SourceModuleName="module2", SourceConnectorIndex=panel_4, TargetModuleName="module2", TargetConnectorIndex=panel_3)
ruleexp_4 = ConstructExplicitRule(SourceModuleName="module2", SourceConnectorIndex=panel_5, TargetModuleName="module3", TargetConnectorIndex=panel_6)
pt_7 = Point(<point referenced from the Rhino model>)
ruleexp_5 = ConstructExplicitRule(SourceModuleName="module1", SourceConnectorIndex=panel_4, TargetModuleName="module1", TargetConnectorIndex=panel_3)
ruleboundpt = RuleAtBoundaryFromPoint(Modules=data, PointTag=pt_7)
merge_9 = Merge(Data1=ruleboundpt, Data2=ruleexp_2, Data3=ruleexp_3, Data4=ruleexp_4, Data5=ruleexp_5, Data6=ruleexp)  # -> flatten(Result)

collectrules = CollectRules(Modules=flatten, RulesAllowed=merge_6, ExplicitRulesDisallowed=merge_9)

wfc = MonocerosWFCSolver(
    Slots=slotall,
    Modules=flatten,
    Rules=flatten(collectrules),
    RandomSeed=Slider(573, range=0..1000),
    MaxAttempts=Slider(100, range=0..100),
    MaxObservations=2147483647,
    MaxTime=0,
    UseShannonEntropy=False)  # -> Out, Slots, Deterministic, Contradictory, Seed, Attempts, Observations
materialize = MaterializeSlots(Modules=graft(flatten), Slots=wfc.Slots)  # -> simplify(Geometry), Transform

area_2 = Area(Geometry=materialize.Geometry)  # -> flatten(Area), Centroid
bnd = Bounds(Numbers=area_2.Area)
remap = RemapNumbers(Value=area_2.Area, Source=bnd, Target=Domain(0, 1))  # -> Mapped, Clipped
gradient = Gradient(
    LowerLimit=0,
    UpperLimit=1,
    Parameter=remap.Mapped,
    stops=[0: RGB(234, 38, 0), 0.174: RGB(234, 126, 0), 0.26: RGB(173, 203, 249), 0.338: RGB(75, 107, 169)])
preview = CustomPreview(Geometry=flatten(materialize.Geometry), Material=gradient)

# ==== cluster Cluster
color = ClusterInput()
mesh = ClusterInput()
light = ClusterInput()
demesh = DeconstructMesh(Mesh=mesh)  # -> Vertices, Faces, Colours, Normals
unit = UnitVector(Vector=light)
dprod = DotProduct(VectorA=demesh.Normals, VectorB=unit, Unitize=False)
remap = RemapNumbers(Value=dprod, Source=Domain(-1, 1), Target=Domain(0, 1))  # -> Mapped, Clipped
graft = GraftTree(Tree=mesh, IncludeEmptyLists=True, IncludeNullItems=True)
multiplication = Multiplication(A=color, B=remap.Mapped)
mcol = MeshColours(Mesh=graft, Colours=multiplication)
mesh_2 = ClusterOutput(mcol)

# ==== cluster Cluster_2
list = ClusterInput()
lng = ListLength(List=list)
subtraction = Subtraction(A=lng, B="2")
dom = ConstructDomain(DomainStart="1", DomainEnd=subtraction)
item = ListItem(List=reverse(list), Index=0, Wrap=True)
item_2 = ListItem(List=list, Index=0, Wrap=True)
subset = SubList(List=list, Domain=dom, Wrap=True)  # -> List, Index
first = ClusterOutput(item_2)
last = ClusterOutput(item)
rest = ClusterOutput(subset.List)
