# Grasshopper definition structure_before.gh (Grasshopper 1.0.7)

geo = Geometry([<brep referenced from the Rhino model> x13])
geo_2 = Geometry(<brep referenced from the Rhino model>)
geo_3 = Geometry([<brep referenced from the Rhino model> x2])
geo_4 = Geometry([<brep referenced from the Rhino model> x13])
geo_5 = Geometry(<brep referenced from the Rhino model>)
mesh = Mesh(geo)
mesh_2 = Mesh(geo_3)
mesh_3 = Mesh(geo_2)
mesh_4 = Mesh(geo_5)
mesh_5 = Mesh(geo_4)
vec = VectorXYZ(XComponent="0.5", YComponent="0.25", ZComponent="1")  # -> Vector, Length
cluster = Cluster_2(list=mesh_2)  # -> first, last, rest
cluster_2 = Cluster_2(list=mesh)  # -> first, last, rest
swatch = ColourSwatch(SwatchColor=RGB(255, 77, 77))
swatch_2 = ColourSwatch(SwatchColor=RGB(255, 190, 77))
swatch_3 = ColourSwatch(SwatchColor=RGB(103, 159, 219))
cluster_3 = Cluster_2(list=mesh_5)  # -> first, last, rest
cluster_4 = Cluster(color=swatch_2, mesh=mesh_3, light=vec.Vector)  # -> flatten(mesh_2)
cluster_5 = Cluster(color=swatch_2, mesh=cluster.last, light=vec.Vector)  # -> flatten(mesh_2)
cluster_6 = Cluster(color=swatch, mesh=cluster.first, light=vec.Vector)  # -> flatten(mesh_2)
cluster_7 = Cluster(color=swatch_3, mesh=cluster_2.first, light=vec.Vector)
cluster_8 = Cluster(color=swatch_2, mesh=cluster_2.last, light=vec.Vector)
cluster_9 = Cluster(color=swatch, mesh=cluster_2.rest, light=vec.Vector)
cluster_10 = Cluster(color=swatch_3, mesh=cluster_3.first, light=vec.Vector)
cluster_11 = Cluster(color=swatch_2, mesh=cluster_3.last, light=vec.Vector)
cluster_12 = Cluster(color=swatch, mesh=cluster_3.rest, light=vec.Vector)
cluster_13 = Cluster(color=swatch_2, mesh=mesh_4, light=vec.Vector)
merge = Merge(Data1=cluster_7, Data2=cluster_8, Data3=cluster_9)  # -> flatten(Result)
merge_2 = Merge(Data1=cluster_5, Data2=cluster_6)  # -> flatten(Result)
merge_3 = Merge(Data1=cluster_10, Data2=cluster_11, Data3=cluster_12)  # -> flatten(Result)
entwine = Entwine(Branch00=cluster_4, Branch01=merge_2, Branch02=merge, Branch03=merge_3, Branch04=cluster_13, FlattenInputs=True)  # -> simplify(Result)
geo_6 = Geometry(entwine)

group = Group(Objects=geo_6)  # -> flatten(Group)
lng = ListLength(List=group)
series = Series(Start=0, Step=1, Count=lng)
concat = Concatenate(FragmentA="module", FragmentB=series)
graft = GraftTree(Tree=concat, IncludeEmptyLists=True, IncludeNullItems=True)

number_slider = Slider(2, range=0..10)
series_2 = Series(Start=number_slider, Step=number_slider, Count=Slider(5, range=0..10))
number_slider_2 = Slider(0.5, range=0..1)
pt = ConstructPoint(XCoordinate=series_2, YCoordinate=0, ZCoordinate=0)
graft_2 = GraftTree(Tree=pt, IncludeEmptyLists=True, IncludeNullItems=True)  # -> simplify(Tree)
box = CenterBox(Base=pt, X=number_slider_2, Y=number_slider_2, Z=number_slider_2)

debrep = DeconstructBrep(Brep=box)  # -> Faces, Edges, Vertices
area = Area(Geometry=debrep.Faces)  # -> Area, Centroid

# ==== cluster Cluster
color = ClusterInput()
mesh = ClusterInput()
light = ClusterInput()
demesh = DeconstructMesh(Mesh=mesh)  # -> Vertices, Faces, Colours, Normals
unit = UnitVector(Vector=light)
dprod = DotProduct(VectorA=demesh.Normals, VectorB=unit, Unitize=False)
remap = RemapNumbers(Value=dprod, Source=Domain(-1, 1), Target=Domain(0, 1))  # -> Mapped, Clipped
graft = GraftTree(Tree=mesh, IncludeEmptyLists=True, IncludeNullItems=True)
multiplication = Multiplication(A=color, B=remap.Mapped)
mcol = MeshColours(Mesh=graft, Colours=multiplication)
mesh_2 = ClusterOutput(mcol)

# ==== cluster Cluster_2
list = ClusterInput()
lng = ListLength(List=list)
subtraction = Subtraction(A=lng, B="2")
dom = ConstructDomain(DomainStart="1", DomainEnd=subtraction)
item = ListItem(List=reverse(list), Index=0, Wrap=True)
item_2 = ListItem(List=list, Index=0, Wrap=True)
subset = SubList(List=list, Domain=dom, Wrap=True)  # -> List, Index
first = ClusterOutput(item_2)
last = ClusterOutput(item)
rest = ClusterOutput(subset.List)
